# Grasshopper definition CuttingLine.ghx (Grasshopper 0.9.76)

panel = Panel("""右クリックから、Set Multiple Surface
↓""")

# ---- group: Dotted Line
number_slider = Slider(0.7, range=0..1)

# ---- group: Offset
number_slider_2 = Slider(5, range=0..10)

# ---- group: Input Surface
srf = Surface([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])

# ---- group: Tab
number_slider_3 = Slider(0.07, range=0..0.2)

# ----
crv = Curve(srf)
explode = Explode(Curve=crv, Recursive=True)  # -> flatten(Segments), Vertices
crv_2 = Curve(explode.Segments)
join = JoinCurves(Curves=crv_2, Preserve=False)
area = Area(Geometry=join)  # -> Area, Centroid
divide = DivideCurve(Curve=crv_2, Count="36", Kinks=False)  # -> Points, Tangents, Parameters
explode_2 = Explode(Curve=join, Recursive=True)  # -> Segments, Vertices
graft = GraftTree(Tree=area.Centroid, IncludeEmptyLists=True, IncludeNullItems=True)
curvepoint = PointOnCurve(explode_2.Segments, parameter=0.514)
vec2pt = Vector2Pt(PointA=graft, PointB=curvepoint, Unitize=False)  # -> Vector, Length
unit = UnitVector(Vector=vec2pt.Vector)
amp = Amplitude(Vector=unit, Amplitude=number_slider_2)
item = ListItem(List=divide.Points, Index="1", Wrap=True)  # -> Item, Item1, Item2, Item3, Item4, Item5, Item6, Item7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
move = Move(Geometry=explode_2.Segments, Motion=amp)  # -> Geometry, Transform
ln = Line(StartPoint=item.Item, EndPoint=item.Item2)
ln_2 = Line(StartPoint=item.Item4, EndPoint=item.Item6)
ln_3 = Line(StartPoint=item.Item8, EndPoint=item.Item10)
ln_4 = Line(StartPoint=item.Item12, EndPoint=item.Item14)
ln_5 = Line(StartPoint=item.Item16, EndPoint=item.Item18)
ln_6 = Line(StartPoint=item.Item20, EndPoint=item.Item22)
ln_7 = Line(StartPoint=item.Item24, EndPoint=item.Item26)
ln_8 = Line(StartPoint=item.Item28, EndPoint=item.Item30)
ln_9 = Line(StartPoint=item.Item32, EndPoint=item.Item34)
curvepoint_2 = PointOnCurve(move.Geometry, parameter=0.514)
merge = Merge(Data1=ln, Data2=ln_2, Data3=ln_3, Data4=ln_4, Data5=ln_5, Data6=ln_6, Data7=ln_7, Data8=ln_8, Data9=ln_9)
scale = Scale(Geometry=move.Geometry, Center=curvepoint_2, Factor=Slider(0.6, range=0..1))  # -> Geometry, Transform
end = EndPoints(Curve=scale.Geometry)  # -> Start, End
end_2 = EndPoints(Curve=explode_2.Segments)  # -> Start, End
flatten = FlattenTree(Tree=merge, Path="{0}")
curvepoint_3 = PointOnCurve(flatten, parameter=0.552)
subtraction = Subtraction(A="0.5", B=number_slider_3)
addition = Addition(A="0.5", B=number_slider_3)
crv_3 = Curve(scale.Geometry)
scale_2 = Scale(Geometry=flatten, Center=curvepoint_3, Factor=number_slider)  # -> Geometry, Transform
cdiv = Derivatives(Curve=reparameterize(crv_3), Parameter=subtraction)  # -> Point, FirstDerivative
cdiv_2 = Derivatives(Curve=reparameterize(crv_3), Parameter=addition)  # -> Point, FirstDerivative
end_3 = EndPoints(Curve=crv_3)  # -> Start, End
pt = Point(cdiv.Point)
pt_2 = Point(cdiv_2.Point)
ln_10 = Line(StartPoint=end_2.Start, EndPoint=end.Start)
ln_11 = Line(StartPoint=end_2.End, EndPoint=end.End)
ln_12 = Line(StartPoint=end_3.Start, EndPoint=cdiv.Point)
ln_13 = Line(StartPoint=end_3.End, EndPoint=cdiv_2.Point)
crv_4 = Curve(scale_2.Geometry)
merge_2 = Merge(Data1=ln_10, Data2=ln_11, Data3=ln_12, Data4=ln_13, Data5=crv_4)
panel_2 = Panel("""右クリックして、Bake
↓""")

# ---- group: Bake
crv_5 = Curve(merge_2)
